# Dynamo graph 01_Revit para Robot_2027.dyn "Revit para Robot" (Dynamo 4.1.1.5050)
# Envia a estrutura do Revit 2027 para o Robot 2027, aplica peso proprio e sobrecarga, calcula e le as reacoes.
# packages: CivilConnection2027 7.0.0

# note: CivilConnection 2027 - Revit para Robot
civilconnection_robot = CodeBlock()
# ---------- civilconnection_robot.designscript (32 lines) ----------
// PARAMETROS (abra o Robot com um projeto qualquer antes de executar)
// criarAnalitico = true cria o modelo analitico do Revit que faltar, ajustando as extremidades ate a tolerancia (m).
// ALTERA O DOCUMENTO DO REVIT: use uma copia do arquivo e revise o resultado.
criarAnalitico = true;
toleranciaAnalitico = 0.25;
// incluirLajes = false deixa de fora as lajes (pisos sobre o solo ficam soltos sem base elastica)
incluirLajes = false;
calcular = true;
// sobrecarga nas lajes em Pa (N/m2), negativa = para baixo
cargaLaje = -3000;
// FLUXO
analitico = criarAnalitico ? CivilConnection.Robot.RobotModel.CreateRevitAnalyticalModel(toleranciaAnalitico, incluirLajes) : null;
elementos = criarAnalitico ? analitico["AnalyticalElements"] : CivilConnection.Robot.RobotModel.RevitAnalyticalElements(true, incluirLajes);
robot = CivilConnection.Robot.RobotModel.Connect(true, "Shell", -1, null);
envio = robot.FromRevitAnalytical(elementos, "", 0.5, 0.5);
// liga as pecas que chegam no meio de outras (juncoes em T)
divididas = robot.SplitBarsAtNodes(envio);
engaste = robot.CreateSupport("ENGASTE", true, true, true, true, true, true);
apoios = robot.AssignSupportToColumnBases(engaste, divididas);
limpar = robot.DeleteAllCases(apoios);
casoG = robot.CreateLoadCase(1, "G - peso proprio", "Permanent", limpar);
pp = robot.AddSelfWeight(casoG, 1);
casoQ = robot.CreateLoadCase(2, "Q - sobrecarga", "Exploatation", pp);
sobrecarga = robot.AddPanelUniformLoads(casoQ, envio["Panels"], 0, 0, cargaLaje, false);
elu = robot.CreateCombination(3, "ELU 1.4G + 1.4Q", [pp, sobrecarga], [1.4, 1.4], "ULS");
malha = robot.GenerateMesh(elu);
calculado = robot.Calculate(calcular, malha);
reacoesG = robot.NodeReactions(apoios, pp, calculado);
pesoProprio_kN = Math.Sum(reacoesG["FZ"]) / 1000;
reacoesELU = robot.NodeReactions(apoios, elu, calculado);
somaFZ_ELU_kN = Math.Sum(reacoesELU["FZ"]) / 1000;
fim = robot.EndSession(somaFZ_ELU_kN);
# ----------------------------------------
watch_analitico = Watch(civilconnection_robot.analitico)
watch_divididas = Watch(civilconnection_robot.divididas)
watch_pesoproprio_kn = Watch(civilconnection_robot.pesoProprio_kN)
watch_somafz_elu_kn = Watch(civilconnection_robot.somaFZ_ELU_kN)
