# Dynamo graph 02_Civil 3D para Robot_2027.dyn "Civil 3D para Robot" (Dynamo 4.1.1.5050)
# Cria no Robot 2027 o tabuleiro entre duas linhas de feicao de um corredor do Civil 3D 2027, com apoios, cargas, calculo e reacoes.
# packages: CivilConnection2027 7.0.0

# note: CivilConnection 2027 - Civil 3D para Robot
civilconnection_robot = CodeBlock()
# ---------- civilconnection_robot.designscript (36 lines) ----------
// PARAMETROS (Civil 3D 2027 com o desenho do corredor aberto, CivilPython instalado e Robot aberto)
calcular = true;
// codigo das linhas de feicao dos bordos do tabuleiro (veja a lista 'codigos')
codigoBordo = "ETW";
// comprimento dos paineis ao longo do bordo e distancia entre apoios, em unidades do Civil 3D
passo = 5;
vao = 30;
// fator de unidade do desenho para metros (1 = desenho em metros)
unidadeParaMetro = 1;
// FLUXO
civil = CivilConnection.CivilApplication();
documento = civil.GetDocuments()[0];
corredor = documento.GetCorridors()[0];
codigos = List.UniqueItems(List.Flatten(corredor.GetFeaturelines(), -1).Code);
bordos = List.Flatten(corredor.GetFeaturelinesByCode(codigoBordo), -1);
origem = bordos[0].Curve.StartPoint;
robot = CivilConnection.Robot.RobotModel.Connect(true, "Shell", unidadeParaMetro, origem);
concreto = robot.CreateMaterial("C35", 29.4e9, 0.2, 25000, "Concrete");
laje = robot.CreatePanelThickness("LAJE 25", 0.25, concreto, 0);
nApoios = Math.Ceiling(bordos[0].Curve.Length / vao) + 1;
t = 0..1..#nApoios;
pontosApoio = List.Flatten([bordos[0].Curve.PointAtParameter(t), bordos[1].Curve.PointAtParameter(t)], -1);
apoio = robot.CreateSupport("APOIO", true, true, true, false, false, false);
apoios = robot.AssignSupportAtPoints(pontosApoio, apoio);
paineis = robot.DeckPanelsBetweenFeaturelines(bordos[0], bordos[1], laje, passo, 0.5);
limpar = robot.DeleteAllCases(paineis);
casoG = robot.CreateLoadCase(1, "G - peso proprio", "Permanent", limpar);
pp = robot.AddSelfWeight(casoG, 1);
casoQ = robot.CreateLoadCase(2, "Q - multidao 5 kPa", "Exploatation", pp);
q = robot.AddPanelUniformLoads(casoQ, paineis, 0, 0, -5000, false);
elu = robot.CreateCombination(3, "ELU 1.35G + 1.5Q", [pp, q], [1.35, 1.5], "ULS");
malha = robot.GenerateMesh(elu);
calculado = robot.Calculate(calcular, malha);
reacoes = robot.NodeReactions(apoios, elu, calculado);
somaFZ_ELU_kN = Math.Sum(reacoes["FZ"]) / 1000;
fim = robot.EndSession(somaFZ_ELU_kN);
# ----------------------------------------
watch_codigos = Watch(civilconnection_robot.codigos)
watch_paineis = Watch(civilconnection_robot.paineis)
watch_somafz_elu_kn = Watch(civilconnection_robot.somaFZ_ELU_kN)
